# Grasshopper definition planar_arch_generator.ghx (Grasshopper 1.0.7)

angle = Slider(20, range=0..45)
width = Slider(10, range=0..10)
aspect_ratio = Slider(0.6, range=0.1..2)
pt = Point(Point(4.047665691, 1.724886209, 0.04008260369))

aspect_ratio_2 = Panel("""0.25
0.50
0.75
1.00
1.50""")
angles = Panel("""0
15
30
45""")
widths = Panel("""2
3
4
5
6""")
python = GhPythonScript(p=pt, angles=angles, widths=widths, ratios=aspect_ratio_2)  # -> out, simplify(points_out); inputs p: Point3d, angles: list, widths: list, ratios: list
# ---------- python: Python ----------
__author__ = "Edvard"
__version__ = "2023.06.12"

import rhinoscriptsyntax as rs
import ghpythonlib.treehelpers as th
from Rhino.Geometry import Vector3d

import math
from copy import deepcopy

width_sublist = [[] for i in range(len(widths))]
print width_sublist

point_sets = [deepcopy(width_sublist) for i in range(len(angles))]

#point_sets = [[] for i in range(len(angles))]

print point_sets


for i,angle in enumerate(angles):
    for j,width in enumerate(widths):
        for ratio in ratios:
            v1 = Vector3d(0,0,0)
            v2 = Vector3d(-width,0,0)
            
            #make end points
            p_start= rs.CopyObject(p,v1)
            p_end = rs.CopyObject(p,v2)
            
            height = (width/2)*ratio
            
            v3 = Vector3d(-width/2,0,height)
            p_mid = rs.CopyObject(p,v3)
            
            p_mid_new = rs.RotateObject(p_mid,p,angle,axis=Vector3d(-1,0,0),copy=True)
            
            point_set = [p_start, p_mid_new, p_end]
            point_sets[i][j].append(point_set)

print point_sets
points_out = th.list_to_tree(point_sets)

print points_out
# ---------- end python ----------

# ----
# SINGLE ARCH
division = Division(A=graft(width), B=2)
rad = Radians(Degrees=graft(angle))
multiplication = Multiplication(A=division, B=graft(aspect_ratio))
X = UnitX(Factor=expr("-x", division))
Z = UnitZ(Factor=multiplication)
X_2 = UnitX(Factor=division)
move = Move(Geometry=pt, Motion=Z)  # -> Geometry, Transform
X_3 = UnitX(Factor=-1)
move_2 = Move(Geometry=pt, Motion=[X_2, X])  # -> Geometry, Transform
rot3d = Rotate3D(Geometry=move.Geometry, Angle=rad, Center=pt, Axis=X_3)  # -> Geometry, Transform
item = ListItem(List=move_2.Geometry, Index=0, Wrap=True)  # -> Item, Item1
merge = Merge(Data1=item.Item, Data2=rot3d.Geometry, Data3=item.Item1)

# ----
# if FALSE then show all
number_slider = Slider(0, range=0..10)
ratio_idx = Slider(1, range=0..10)
python_2 = GhPythonScript(
    angle_idx=number_slider,
    angle_filter=Toggle(True),
    width_idx=Slider(4, range=0..10),
    width_filter=Toggle(True),
    ratio_idx=ratio_idx,
    ratio_filter=Toggle(False))  # -> out, path; inputs angle_idx: Int32, width_idx: Int32, ratio_idx: Int32
# ---------- python_2: Python ----------
__author__ = "Edvard"
__version__ = "2023.06.12"

import rhinoscriptsyntax as rs

if angle_filter:
    i = angle_idx
else:
    i = "?"

if width_filter:
    j = width_idx
else:
    j = "?"
    
if ratio_filter:
    k = ratio_idx
else:
    k = "?"

path = "{{{};{};{}}}".format(i,j,k)

print path
# ---------- end python_2 ----------

# ----
# 3D GRID OF ARCHES
pt_2 = Point(python.points_out)
viewer = ParamViewer(python.points_out)
panel = Panel(python_2.path)
split = SplitTree(Data=python.points_out, Masks=flatten(python_2.path))  # -> Positive, Negative
viewer_2 = ParamViewer(split.Positive)

# ----
# draw brick volumes tangent to the curve. unique number of bricks per leg of arch.
pt_3 = Point(split.Positive)
intcrv = Interpolate(Vertices=pt_3, Degree=3, Periodic=False, KnotStyle=1)  # -> Curve, Length, Domain
len = Length(Curve=flatten(intcrv.Curve))
division_2 = Division(A="0.075", B=2)
division_3 = Division(A="0.225", B=2)
division_4 = Division(A="0.1125", B=2)
division_5 = Division(A=len, B="0.075")
crv = Curve(intcrv.Curve)
int = Integer(graft(division_5))
divide = DivideCurve(Curve=crv, Count=int, Kinks=False)  # -> Points, Tangents, Parameters
pframe = PerpFrame(Curve=crv, Parameter=divide.Parameters)
box = CenterBox(Base=pframe, X=division_3, Y=division_4, Z=division_2)
