# Grasshopper definition vizualize_pnts.ghx (Grasshopper 1.0.7)
# plug-ins: Karamba3D, Human

# ----
# 170,469 is the total number of points
# for R1 work volume at 0.1m spacing
# x: -3.2 --> 6.0
# y: 0.3 --> 4.9
# z: -0.4 --> 3.4
# 
# 170,469 is the total number of points
# for R2 work volume at 0.1m spacing
# x: -3.2 --> 6.0
# y: -1.5 --> 3.1
# z: -0.4 --> 3.4
# 
# 162,240 is the total number of points
# for R3 work volume at 0.1m spacing
# x: 1.7 --> 8.0
# y: -1.5 --> 4.9
# z: -0.4 --> 3.4
# 
# 286,455 is the total number of points
# for 3 robot work volume at 0.1m spacing
# x: -3.2 --> 8.0
# y: -1.5 --> 4.9
# z: -0.4 --> 3.4
panel = Panel("results_planar_arches")
cumulative_steps = Slider(100, range=1..100)
list = ValueList({"Robot 1": "rob1", "Robot 2": "rob2", "Robot 3": "rob3", "Robot 1&2": "rob1,rob2", "Robot 1&3": "rob1,rob3", "Robot 2&3": "rob2,rob3", "Robot 1&2&3": "rob1,rob2,rob3"}, selected="Robot 1&2")
list_2 = ValueList({"YES TRACK": "/Users/edvard/Documents/github/rob_fab_reach/_data_track", "NO TRACK": "/Users/edvard/Documents/github/rob_fab_reach/_data_notrack"}, selected="NO TRACK")

pt = ConstructPoint(XCoordinate="4.1", YCoordinate="1.7", ZCoordinate="-0.2")
# single direction reachability
number_slider = Slider(50, range=1..100)

# ----
# 'n' robots reach
# (0 and 1, equivalent to No/Yes)
# (2 and 3, if you are reading in data for 2 or 3 robs)
number_slider_2 = Slider(3, range=0..3)
data = Data(list_2)
data_2 = Data("{}/{}_vec{:0>3}.json")
data_3 = Data(list)
data_4 = Data(number_slider)
python = GhPythonScript(path=data, name=data_2, rob_num=data_3, step_num=data_4, read_data=Toggle(False))  # -> points, values, vector; inputs step_num: Int32
# ---------- python: Python ----------
import os
import json
from compas_fab.utilities import read_data_from_json
from compas_fab.robots import Configuration


def initialize_count(rob_num):
    
    point_count = {}
    
    for rob in rob_num:
        print rob
        filename = name.format(rob,rob,1) # just take first to init
        filepath = os.path.join(path, filename)
        
        print filepath
        
        with open(filepath, "r") as f:
            file_data = f.read()
            
        f.close()
        
        data = json.loads(file_data)
        point_count.update(data['results'])
        
        print len(point_count)
        
    for key in point_count:
        point_count[key] = 0
    
    return point_count


if read_data:
    
    rob_num = rob_num.split(",")
    point_count = initialize_count(rob_num)
    
    for rob in rob_num:
        print "read", rob
        filename = name.format(rob,rob,step_num)
        filepath = os.path.join(path, filename)
    
        with open(filepath, "r") as f:
            file_data = f.read()
            data = json.loads(file_data)
            f.close()
        
        for pnt,result in data['results'].items():
            if result:
                point_count[pnt] += 1
                    
    vector = data['vector']
    points = point_count.keys()
    values = point_count.values()
# ---------- end python ----------

# ----
# cumulative reachability - total
# all-reach = only points that all robots in the setup can reach. Otherwise show points that can be reached by at least one robot
toggle = BooleanToggle(False)
data_5 = Data(list_2)
data_6 = Data("{}/_{}_TOTAL.json")
data_7 = Data(list)
python_2 = GhPythonScript(path=data_5, name=data_6, rob_num=data_7, read_data=toggle)  # -> points, values, reach_coop_bools, reach_single_bools, simplify(vectors)
# ---------- python_2: Python ----------
import os
import json
from compas_fab.utilities import read_data_from_json
from compas_fab.robots import Configuration

from copy import deepcopy
from collections import OrderedDict


"""
286,455 is the total number of points
for 3 robot work volume at 0.1m spacing
x: -3.2 --> 8.0
y: -1.5 --> 4.9
z: -0.4 --> 3.4
"""

"""
235,755 is the total number of points
for 2 robot work volume at 0.1m spacing
x: -3.2 --> 6.0
y: -1.5 --> 4.9
z: -0.4 --> 3.4
"""


def count_data(rob_num):
    count_total = OrderedDict() #keep them same order later when copying
    count_cooperative = OrderedDict()
    
    #read in data based on how many robots
    filepaths = [os.path.join(path, name.format(rob,rob)) for rob in rob_num]
    files = [open(filepath, "r") for filepath in filepaths]
    datas = [json.loads(file.read()) for file in files]
    
    for f in files:
        f.close()
    
    #initialize the dictionary, each unique point
    for data in datas:
        count_total.update(data['results'])
    
    #zero all the values in the dictionary
    for key in count_total:
        count_total[key] = 0
        
    count_cooperative = count_total.copy()
    
    #read in all data, sum in total count, sum in # robs reached
    for data in datas:
        for key,value in data['results'].items():
            
            if value:
                count_total[key] += value
                count_cooperative[key] += 1


    return count_total, count_cooperative



if read_data:
    rob_num = rob_num.split(",")
    
    count_total,count_cooperative = count_data(rob_num)
    
    reach_coop = deepcopy(count_cooperative)
    reach_single = deepcopy(count_cooperative)
    
#    if all_reach: #save points all can reach
    for key,value in reach_coop.items():
        if value == len(rob_num):
            reach_coop[key] = 1
        else:
            reach_coop[key] = 0
                
#    else: #save points at least one robot can reach
    for key,value in reach_single.items():
        if value == len(rob_num):
            reach_single[key] = 1
        
    
    points = count_total.keys()
    values = count_total.values()
    reach_coop_bools = reach_coop.values()
    reach_single_bools = reach_single.values()
    
    #    vectors = th.list_to_tree(vectors, source=[0,0])
# ---------- end python_2 ----------

# ----
# cumulative reachability - one by one
toggle_2 = BooleanToggle(False)
data_8 = Data(list_2)
data_9 = Data("{}/{}_vec{:0>3}.json")
data_10 = Data(list)
data_11 = Data(cumulative_steps)
python_3 = GhPythonScript(path=data_8, name=data_9, rob_num=data_10, step_num=data_11, read_data=toggle_2)  # -> points, values, coop_points, simplify(vectors); inputs step_num: Int32
# ---------- python_3: Python ----------
import os
import json
from compas_fab.utilities import read_data_from_json
from compas_fab.robots import Configuration

import ghpythonlib.treehelpers as th

"""
243,360 is the total number of points
for 3 robot work volume at 0.1m spacing
x: -1.5 --> 8.0
y: -1.5 --> 4.9
z: -0.4 --> 3.4
"""

def initialize_count(rob_num):
    """return a dictionary full of 0s"""
    
    point_count = {}
    
    for rob in rob_num:
        filename = name.format(rob,rob,1) # just take first to init
        filepath = os.path.join(path, filename)
        
        with open(filepath, "r") as f:
            file_data = f.read()
            
        f.close()
        
        data = json.loads(file_data)
        point_count.update(data['results'])
        
        print len(point_count)
        
    for key in point_count:
        point_count[key] = 0
    
    return point_count

    

if read_data:
    
    rob_num = rob_num.split(",")
    
    point_count = initialize_count(rob_num)
    cooperative_count_save = point_count.copy()
    cooperative_count_zero = point_count.copy()
    vectors = []
    
        
    for i in range(1,step_num+1):
        
        # re-zero it
        cooperative_count = cooperative_count_zero.copy()

        for rob in rob_num:
            print "{}: vector {}".format(rob,i)
            
            filename = name.format(rob,rob,i)
            filepath = os.path.join(path, filename)
            
            with open(filepath, "r") as f:
                file_data = f.read()
                data = json.loads(file_data)
                f.close()
                
                vec = data['vector']
                vectors.append(vec)
            
            for pnt,result in data['results'].items():
                if result:
                    cooperative_count[pnt] += 1
                    point_count[pnt] += 1
                    
        #after all robs done
        #keep over-writing if already 1, then stays 1
        for pnt,result in cooperative_count.items():
            if result == len(rob_num):
                cooperative_count_save[pnt] = 1
            
    #output data
    vectors = th.list_to_tree(vectors, source=[0,0])
    points = point_count.keys()
    values = point_count.values()
    
    coop_points = cooperative_count_save.values()
# ---------- end python_3 ----------
num = Number(python_3.vectors)

angles = Panel("""0
15
30
45""")
span = Panel("""2
3
4
5
6
7""")
aspect_ratio = Panel("""0.25
0.50
0.75
1.00
1.50
2.00""")
panel_2 = Panel("arch start point")
pt_2 = Point(pt)
python_4 = GhPythonScript(p=pt_2, angles=angles, spans=span, ratios=aspect_ratio)  # -> simplify(points_out), simplify(variables_out); inputs p: Point3d, angles: list, spans: list, ratios: list
# ---------- python_4: Python ----------
__author__ = "Edvard"
__version__ = "2023.06.12"

import rhinoscriptsyntax as rs
import ghpythonlib.treehelpers as th
from Rhino.Geometry import Vector3d

import math
from copy import deepcopy

span_sublist = [[] for i in range(len(spans))]
point_sets = [deepcopy(span_sublist) for i in range(len(angles))]
data_sets = deepcopy(point_sets)

print point_sets


for i,angle in enumerate(angles):
    for j,span in enumerate(spans):
        for ratio in ratios:
            v1 = Vector3d(0,0,0)
            v2 = Vector3d(-span,0,0)
            
            #make end points
            p_start= rs.CopyObject(p,v1)
            p_end = rs.CopyObject(p,v2)
            
            height = (span/2)*ratio
            
            v3 = Vector3d(-span/2,0,height)
            p_mid = rs.CopyObject(p,v3)
            
            p_mid_new = rs.RotateObject(p_mid,p,angle,axis=Vector3d(-1,0,0),copy=True)
            
            point_set = [p_start, p_mid_new, p_end]
            point_sets[i][j].append(point_set)
            data_sets[i][j].append([angle,span,ratio])
            
            

#print point_sets
print data_sets
points_out = th.list_to_tree(point_sets)
variables_out = th.list_to_tree(data_sets)
# ---------- end python_4 ----------

# ----
# if TRUE then show all for variable
span_idx = Slider(5, range=0..10)
ratio_idx = Slider(0, range=0..10)
python_5 = GhPythonScript(
    angle_idx=Slider(0, range=0..10),
    angle_filter=Toggle(True),
    span_idx=span_idx,
    span_filter=Toggle(True),
    ratio_idx=ratio_idx,
    ratio_filter=Toggle(True))  # -> out, path; inputs angle_idx: Int32, span_idx: Int32, ratio_idx: Int32
# ---------- python_5: Python ----------
__author__ = "Edvard"
__version__ = "2023.06.12"

import rhinoscriptsyntax as rs

if angle_filter:
    i = "?"
else:
    i = angle_idx
    

if span_filter:
    j = "?"
else:
    j = span_idx
    
    
if ratio_filter:
    k = "?"
else:
    k = ratio_idx
    

path = "{{{};{};{}}}".format(i,j,k)

print path
# ---------- end python_5 ----------

int = Integer(number_slider_2)
mindex = MemberIndex(Set=python.values, Member=int)  # -> Index, Count
dispatch = Dispatch(List=python.points, DispatchPattern=python.values)  # -> ListA, ListB
item = ListItem(List=python.points, Index=mindex.Index, Wrap=True)

list_3 = ValueList({"From One-by-One": 0, "From Total": 1}, selected="From Total")
filter = StreamFilter(Gate=list_3, Stream0=python_3.points, Stream1=python_2.points)
filter_2 = StreamFilter(Gate=list_3, Stream0=python_3.values, Stream1=python_2.values)
filter_3 = StreamFilter(Gate=list_3, Stream0=python_3.coop_points, Stream1=python_2.reach_coop_bools)
filter_4 = StreamFilter(Gate=list_3, Stream0=python_3.coop_points, Stream1=python_2.reach_single_bools)
int_2 = Integer(filter_4)
pt_3 = Point(filter)
int_3 = Integer(filter_2)
int_4 = Integer(filter_3)

int_5 = Integer(int_3)
data_12 = Data(cumulative_steps)
data_13 = Data(list)
values = GhPythonScript(rob_num=data_13, values=int_5, n_steps=data_12)  # -> max_index, max_counts, counts; inputs values: list, n_steps: Int32
# ---------- values: Python ----------
counts = []

rob_num = rob_num.split(",")

# maximum number of possible reaches per point
max = n_steps * len(rob_num)

# count how many times a number of reaches occurs
for i in range(0,max + 1):
    counts.append(values.count(i))

# what is the maximum number of reaches in whole volume
for i,cnt in enumerate(counts):
    if cnt:
        max_index = i

# for many points does maximum number of reaches occur
max_counts = counts[max_index]
# ---------- end values ----------
panel_3 = Panel(values.counts)
panel_4 = Panel(values.max_index)
panel_5 = Panel(values.max_counts)
rec = DataRecorder(panel_5, DataLimit=-10, RecordData=False)
panel_6 = Panel(rec)

# ----
# Create a 3D grid of arch geometries
panel_7 = Panel(python_5.path)
viewer = ParamViewer(python_4.points_out)
split = SplitTree(Data=python_4.points_out, Masks=flatten(python_5.path))  # -> Positive, Negative
viewer_2 = ParamViewer(split.Positive)
split_2 = SplitTree(Data=python_4.variables_out, Masks=flatten(python_5.path))  # -> Positive, Negative

# ----
# View Reach Vector
item_2 = ListItem(List=python.vector, Index=0, Wrap=True)  # -> Item, Item1, Item2
panel_8 = Panel(python.vector)
pt_4 = ConstructPoint(XCoordinate=0, YCoordinate=-5, ZCoordinate=0)
vec = VectorXYZ(XComponent=item_2.Item, YComponent=item_2.Item1, ZComponent=item_2.Item2)  # -> Vector, Length
vdisex = VectorDisplayEx(Point=pt_4, Vector=vec.Vector, Colour=ColourSwatch(SwatchColor=RGB(252, 167, 167)), Width="8")

# ----
# YES reach
lng = ListLength(List=dispatch.ListA)
panel_9 = Panel(lng)
preview = CustomPreview(Geometry=dispatch.ListA, Material=ColourSwatch(SwatchColor=RGB(0, 34, 255)))

# ----
# NO reach
lng_2 = ListLength(List=dispatch.ListB)
panel_10 = Panel(lng_2)
preview_2 = CustomPreview(Geometry=dispatch.ListB, Material=ColourSwatch(SwatchColor=RGB(0, 0, 0)))

# ----
# 'n' robot reach
lng_3 = ListLength(List=item)
panel_11 = Panel(lng_3)
preview_3 = CustomPreview(Geometry=item, Material=ColourSwatch(SwatchColor=RGB(250, 12, 12)))

# ----
# See all points
panel_12 = Panel(panel_4)
gradient = Gradient(
    LowerLimit="0",
    UpperLimit=panel_12,
    Parameter=int_3,
    stops=[0: RGB(255, 255, 255), 0.1: RGB(236, 27, 60), 0.2: RGB(210, 0, 118), 0.3: RGB(103, 0, 120), 0.4: RGB(39, 72, 161), 0.5: RGB(1, 192, 229), 0.6: RGB(18, 178, 90), 0.7: RGB(79, 186, 8), 0.8: RGB(220, 237, 32), 0.9: RGB(247, 159, 20), 1: RGB(243, 57, 0)])
gradient_2 = Gradient(
    LowerLimit="0",
    UpperLimit=panel_12,
    Parameter=int_3,
    stops=[0: RGB(255, 255, 255), 0.8: RGB(255, 0, 0), 0.986: RGB(145, 0, 0), 1: RGB(0, 0, 0)])
preview_4 = CustomPreview(Geometry=pt_3, Material=gradient)  # disabled

# ----
# See points with a specified number of reaches
panel_13 = Panel("0")
int_6 = Integer(panel_13)
mindex_2 = MemberIndex(Set=int_3, Member=int_6)  # -> Index, Count
item_3 = ListItem(List=pt_3, Index=mindex_2.Index, Wrap=True)
preview_5 = CustomPreview(Geometry=item_3, Material=ColourSwatch(SwatchColor=RGB(0, 34, 255)))  # disabled

# ----
# See points with a specified % of maximum reaches
panel_14 = Panel(panel_4)
multiplication = Multiplication(A=panel_14, B=Slider(1, range=0..1))
larger = LargerThan(FirstNumber=int_3, SecondNumber=multiplication)  # -> LargerThan, OrEqualTo
dispatch_2 = Dispatch(List=pt_3, DispatchPattern=larger.OrEqualTo)  # -> ListA, ListB
preview_6 = CustomPreview(Geometry=dispatch_2.ListA, Material=ColourSwatch(SwatchColor=RGB(217, 80, 80)))  # disabled

# ----
# See points with 100% of maximum reaches
panel_15 = Panel(panel_4)
int_7 = Integer(panel_15)
mindex_3 = MemberIndex(Set=int_3, Member=int_7)  # -> Index, Count
item_4 = ListItem(List=pt_3, Index=mindex_3.Index, Wrap=True)
preview_7 = CustomPreview(Geometry=item_4, Material=ColourSwatch(SwatchColor=RGB(0, 0, 0)))  # disabled

flip = FlipMatrix(Data=num)
branch = TreeBranch(Tree=flip, Path="{1}", MaintainPaths=True)
branch_2 = TreeBranch(Tree=flip, Path="{2}", MaintainPaths=True)
branch_3 = TreeBranch(Tree=flip, Path="{0}", MaintainPaths=True)
pt_5 = ConstructPoint(XCoordinate=6, YCoordinate=-3, ZCoordinate=0)
vec_2 = VectorXYZ(XComponent=branch_3, YComponent=branch, ZComponent=branch_2)  # -> Vector, Length
vdisex_2 = VectorDisplayEx(Point=pt_5, Vector=vec_2.Vector, Colour=RGB(0, 0, 0), Width="1")

# ----
# See points where ALL robots can reach
dispatch_3 = Dispatch(List=pt_3, DispatchPattern=int_4)  # -> ListA, ListB
dispatch_4 = Dispatch(List=int_3, DispatchPattern=int_4)  # -> ListA, ListB
panel_16 = Panel(panel_4)
gradient_3 = Gradient(
    LowerLimit="0",
    UpperLimit=panel_16,
    Parameter=dispatch_4.ListA,
    stops=[0: RGB(255, 255, 255), 0.1: RGB(236, 27, 60), 0.2: RGB(210, 0, 118), 0.3: RGB(103, 0, 120), 0.4: RGB(39, 72, 161), 0.5: RGB(1, 192, 229), 0.6: RGB(18, 178, 90), 0.7: RGB(79, 186, 8), 0.8: RGB(220, 237, 32), 0.9: RGB(247, 159, 20), 1: RGB(243, 57, 0)])
pt_6 = Point(dispatch_3.ListA)
preview_8 = CustomPreview(Geometry=pt_6, Material=gradient_3)

# ----
# See points where AT LEAST ONE robot can reach
dispatch_5 = Dispatch(List=pt_3, DispatchPattern=int_2)  # -> ListA, ListB
dispatch_6 = Dispatch(List=int_3, DispatchPattern=int_2)  # -> ListA, ListB
panel_17 = Panel(panel_4)
gradient_4 = Gradient(
    LowerLimit="0",
    UpperLimit=panel_17,
    Parameter=dispatch_6.ListA,
    stops=[0: RGB(255, 255, 255), 0.1: RGB(236, 27, 60), 0.2: RGB(210, 0, 118), 0.3: RGB(103, 0, 120), 0.4: RGB(39, 72, 161), 0.5: RGB(1, 192, 229), 0.6: RGB(18, 178, 90), 0.7: RGB(79, 186, 8), 0.8: RGB(220, 237, 32), 0.9: RGB(247, 159, 20), 1: RGB(243, 57, 0)])
pt_7 = Point(dispatch_5.ListA)
preview_9 = CustomPreview(Geometry=pt_7, Material=gradient_4)  # disabled

height_m = Panel("0.225")
width_m = Panel("0.1125")
thickness_m = Panel("0.075")
panel_18 = Panel("brick geometry")
division = Division(A=thickness_m, B=2)
division_2 = Division(A=height_m, B=2)
division_3 = Division(A=width_m, B=2)

# ----
# Create arch curves
# create curve based on 3 points (start, middle, end)
# draw brick volumes tangent to the curve. unique number of bricks per leg of arch.
pt_8 = Point(split.Positive)
intcrv = Interpolate(Vertices=pt_8, Degree=3, Periodic=False, KnotStyle=1)  # -> Curve, Length, Domain
len = Length(Curve=flatten(intcrv.Curve))
division_4 = Division(A=len, B=thickness_m)
crv = Curve(intcrv.Curve)
int_8 = Integer(graft(division_4))
divide = DivideCurve(Curve=crv, Count=int_8, Kinks=False)  # -> Points, Tangents, Parameters
shatter = Shatter(Curve=crv, Parameters=divide.Parameters)  # -> simplify(Segments)
midpt = CurveMiddle(Curve=shatter)
crv_cp = CurveClosestPoint(Point=midpt, Curve=crv)  # -> Point, Parameter, Distance
pframe = PerpFrame(Curve=crv, Parameter=crv_cp.Parameter)  # -> simplify(Frame)
box = CenterBox(Base=pframe, X=division_2, Y=division_3, Z=division)

# ----
# R1
panel_19 = Panel("{6.0,0.3,3.4}")
# visualize search volumes
# search domain, diagonal corners
panel_20 = Panel("{-3.2,4.9,-0.4}")
pt_9 = Point(panel_20)
pt_10 = Point(panel_19)
box_2 = Box2Pt(PointA=pt_9, PointB=pt_10, Plane=PlaneXY(0, 0, 0))
preview_10 = CustomPreview(Geometry=box_2, Material=ColourSwatch(SwatchColor=RGBA(255, 0, 0, 64)))

panel_21 = Panel("collision mesh (ground)")
pt_11 = Point("{-3,-3,-0.4}")
pt_12 = Point("{7,6,-0.375}")
box_3 = Box2Pt(PointA=pt_11, PointB=pt_12, Plane=PlaneXY(0, 0, 0))

# ----
# R2
panel_22 = Panel("{-3.2,-1.5,-0.4}")
pt_13 = Point("{6.0,3.1,3.4}")
pt_14 = Point(panel_22)
box_4 = Box2Pt(PointA=pt_14, PointB=pt_13, Plane=PlaneXY(0, 0, 0))
preview_11 = CustomPreview(Geometry=box_4, Material=ColourSwatch(SwatchColor=RGBA(0, 34, 255, 64)))

# ----
# R3
panel_23 = Panel("{1.7,-1.5,-0.4}")
pt_15 = Point(panel_23)
pt_16 = Point("{8.0,4.9,3.4}")
box_5 = Box2Pt(PointA=pt_15, PointB=pt_16, Plane=PlaneXY(0, 0, 0))
preview_12 = CustomPreview(Geometry=box_5, Material=ColourSwatch(SwatchColor=RGBA(255, 255, 0, 64)))

pt_17 = Point(pt_6)
int_9 = Integer(dispatch_4.ListA)
pt_18 = Point(dispatch_5.ListA)
int_10 = Integer(dispatch_6.ListA)

sint = SolidIntersection(BrepsA=box_4, BrepsB=box_2)
sdiff = SolidDifference(BrepsA=box_4, BrepsB=box_2)
sdiff_2 = SolidDifference(BrepsA=box_2, BrepsB=box_4)
sint_2 = SolidIntersection(BrepsA=sint, BrepsB=box_5)
sdiff_3 = SolidDifference(BrepsA=sint, BrepsB=box_5)
preview_13 = CustomPreview(Geometry=sint_2, Material=ColourSwatch(SwatchColor=RGBA(255, 0, 0, 64)))  # disabled
preview_14 = CustomPreview(Geometry=sdiff_3, Material=ColourSwatch(SwatchColor=RGBA(255, 255, 0, 64)))  # disabled
preview_15 = CustomPreview(Geometry=[sdiff, sdiff_2], Material=ColourSwatch(SwatchColor=RGBA(0, 34, 255, 64)))  # disabled

crv_2 = Curve(shatter)

# ----
# select subset of curve for analysis
# what % of arch to build
list_4 = ValueList({"25%": 0.25, "50%": 0.50, "75%": 0.75, "100%": 1.00}, selected="100%")
lng_4 = ListLength(List=crv_2)
multiplication_2 = Multiplication(A=lng_4, B=list_4)
end = EndPoints(Curve=crv_2)  # -> Start, End
round = Round(Number=multiplication_2)  # -> Nearest, Floor, Ceiling
dom = ConstructDomain(DomainStart=0, DomainEnd=expr("x-1", round.Nearest))
panel_24 = Panel(dom)
pt_19 = Point(end.Start)
pt_20 = Point(end.End)
subset = SubList(List=pt_19, Domain=dom, Wrap=True)  # -> List, Index
subset_2 = SubList(List=pt_20, Domain=dom, Wrap=True)  # -> List, Index
subset_3 = SubList(List=pt_19, Domain=dom, Wrap=True)  # -> List, Index
subset_4 = SubList(List=box, Domain=dom, Wrap=True)  # -> List, Index
shift = ShiftList(List=subset_3.List, Shift=1, Wrap=False)  # -> simplify(List)
item_5 = ListItem(List=subset.List, Index=0, Wrap=True)  # -> simplify(Item)
item_6 = ListItem(List=subset_2.List, Index=-1, Wrap=True)  # -> simplify(Item)
ln = Line(StartPoint=subset_3.List, EndPoint=subset_2.List)  # -> simplify(Line)
mesh = Mesh(subset_4.List)
pt_21 = Point(item_5)
pt_22 = Point(item_6)
pt_23 = Point(shift)

viewer_3 = ParamViewer(ln)
crv_3 = Curve(ln)

panel_25 = Panel("regular points")
pt_24 = Point(pt_23)
msphere = MeshSphere(Base=pt_24, Radius="20/1000", UCount=10, VCount=20)
preview_16 = CustomPreview(Geometry=msphere, Material=ColourSwatch(SwatchColor=RGB(250, 140, 37)))

panel_26 = Panel("support pnts")
pt_25 = Point([pt_22, pt_21])
msphere_2 = MeshSphere(Base=pt_25, Radius="30/1000", UCount=10, VCount=20)
preview_17 = CustomPreview(Geometry=msphere_2, Material=ColourSwatch(SwatchColor=RGB(37, 207, 250)))

panel_27 = Panel("elements")
crv_4 = Curve()
crv_5 = Curve(crv_3)
entwine = Entwine(Branch00=crv_5, Branch01=crv_4, FlattenInputs=True)
entwine_2 = Entwine(
    Branch00=ColourSwatch(SwatchColor=RGB(0, 0, 0)),
    Branch01=ColourSwatch(SwatchColor=RGB(202, 87, 255)),
    FlattenInputs=True)
entwine_3 = Entwine(Branch00="3", Branch01="3", FlattenInputs=True)
previewlw = CustomPreviewLineweights(Geometry=entwine, Shader=entwine_2, Thickness=entwine_3, Absolute=False)

# ----
# vizualize
pt_26 = Point()
msphere_3 = MeshSphere(Base=pt_26, Radius="60/1000", UCount=10, VCount=20)
preview_18 = CustomPreview(Geometry=msphere_3, Material=ColourSwatch(SwatchColor=RGB(4, 189, 50)))  # disabled

spring_kn_m_3 = Panel("100000000")
spring_kn_rad_m_3 = Panel("800000")
arch_thickness_m = Panel(height_m)
arch_width_m = Panel(width_m)
multiplication_3 = Multiplication(A=arch_thickness_m, B=arch_width_m)
panel_28 = Panel(multiplication_3)
multiplication_4 = Multiplication(A=multiplication_3, B=spring_kn_rad_m_3)
multiplication_5 = Multiplication(A=multiplication_3, B=spring_kn_m_3)
linear_stiffness_kn_m = Panel(multiplication_5)
rotational_stiffness_kn_rad = Panel(multiplication_4)
has_translation_spring = BooleanToggle(True)
has_rotation_spring = BooleanToggle(True)
num_2 = Number(multiplication_5)
num_3 = Number(multiplication_4)
python_6 = GhPythonScript(
    spring_translational_stiffness=num_2,
    spring_rotational_stiffness=num_3,
    has_translation_spring=has_translation_spring,
    has_rotation_spring=has_rotation_spring)  # -> out, ct, cr, dof; inputs has_translation_spring: Boolean, has_rotation_spring: Boolean
# ---------- python_6: Python ----------
import rhinoscriptsyntax as rs

dof = []

tras = spring_translational_stiffness
rots = spring_rotational_stiffness

if has_translation_spring:
    dof.extend(list(range(0, 3)))
    ct = rs.AddPoint(tras, tras, tras)
else:
    ct = rs.AddPoint(0, 0, 0)

if has_rotation_spring:
    dof.extend(list(range(3, 6)))
    cr = rs.AddPoint(rots, rots, rots)
else:
    cr = rs.AddPoint(0, 0, 0)
# ---------- end python_6 ----------
vec_3 = Vector(python_6.ct)
vec_4 = Vector(python_6.cr)
int_11 = Integer(python_6.dof)

# ----
# reorient inclined arch members
modulus_kn_cm_2 = Panel("3000")
density_kn_m_3 = Panel("14")
number = Number(modulus_kn_cm_2)
division_5 = Division(A=number, B="2.5")
matprops = MaterialPropertiesKaramba3D(
    FamilyOfMaterial="bricks",
    Name="bricks",
    YoungsModulus_kN_cm2=number,
    InPlaneShearModulus_kN_cm2=division_5,
    TransverseShearModulus_kN_cm2=division_5,
    SpecificWeight_kN_m3=density_kn_m_3,
    CoefficientOfThermalExpansion_1_C=1.2e-05,
    TensileStrength_kN_cm2=23.5,
    CompressiveStrength_kN_cm2=-23.5,
    StrengthHypothesis="MISES",
    mode="Isotrop")
number_2 = Number(height_m)
number_3 = Number(width_m)
multiplication_6 = Multiplication(A=number_2, B=100)
multiplication_7 = Multiplication(A=number_3, B=100)
height_cm = Panel(multiplication_6)
width_cm = Panel(multiplication_7)
material = MaterialKaramba3D(matprops)
cross_section = CrossSectionKaramba3D(
    FamilyNameOfCrossSection="DefaultCroSec",
    Material=material,
    Height_cm=height_cm,
    UpperFlangeWidth_cm=width_cm,
    LowerFlangeWidth_cm=width_cm,
    mode="Trapezoid")
pln = Plane(pframe)
deplane = DeconstructPlane(Plane=pln)  # -> Origin, XAxis, YAxis, ZAxis
crosec = CrossSectionKaramba3D(cross_section)

# ----
# support node force 1/2 of normal node force
data_14 = Data(height_m)
data_15 = Data(width_m)
data_16 = Data(thickness_m)
data_17 = Data(density_kn_m_3)
multiplication_8 = Multiplication(A=data_14, B=data_15, C=data_16)
multiplication_9 = Multiplication(A=data_17, B=multiplication_8)
applied_load_kn = Panel(multiplication_9)
Z = UnitZ(Factor=expr("-x", applied_load_kn))
scale_up_self_weight = Panel("1")
multiplication_10 = Multiplication(A=Z, B=scale_up_self_weight)
division_6 = Division(A=multiplication_10, B="2")

# ----
# if you want to align supports with a plane
panel_29 = Panel("brick nodes")
panel_30 = Panel("end supports")
pln_2 = Plane(pframe)
pt_27 = Point(pt_22)
pt_28 = Point(pt_21)
pt_29 = Point(pt_23)
item_7 = ListItem(List=pln_2, Index=-1, Wrap=True)  # -> Item, Item1
deplane_2 = DeconstructPlane(Plane=item_7.Item)  # -> Origin, XAxis, YAxis, ZAxis
pl = ConstructPlane(Origin=deplane_2.Origin, XAxis=expr("-x", deplane_2.XAxis), YAxis=deplane_2.YAxis)

panel_31 = Panel("other nodes")
panel_32 = Panel("support nodes")
pt_30 = Point(pt_21)
pt_31 = Point(pt_22)
pt_32 = Point(pt_23)

license = LicenseKaramba3D()
panel_33 = Panel(license)

pt_33 = Point(pt_28)
pln_3 = Plane(item_7.Item1)
pt_34 = Point(pt_27)
pln_4 = Plane(pl)
pt_35 = Point(pt_29)
supp = SupportKaramba3D(PosInd=pt_33, menu=[buttons(on, on, on, on, on, off)])
supp_2 = SupportKaramba3D(PosInd=pt_34, menu=[buttons(on, on, on, off, off, off)])
supp_3 = SupportKaramba3D(PosInd=pt_35, menu=[buttons(off, off, off, off, off, off)])
support = SupportKaramba3D(simplify(supp_2))
support_2 = SupportKaramba3D(simplify(supp_3))
support_3 = SupportKaramba3D(simplify(supp))
merge = Merge(Data1=support_3, Data2=support)

crv_6 = Curve(crv_3)
crosec_2 = CrossSectionKaramba3D(crosec)
vec_5 = Vector(deplane.XAxis)
linetobeam = LineToBeamKaramba3D(
    Line=crv_6,
    Identifier="bricks",
    CrossSection=crosec_2,
    New=True,
    Remove=True,
    LimitDistance_m=0.005,
    ZOrientation=vec_5,
    Bending=True,
    SetBucklingLength=True,
    ToPolylineMaxAngle=0.03,
    ToPolylineTolerance=0.01,
    ToPolylineMinEdgeLength=0.25)  # -> Element, Points, Info
element = ElementKaramba3D(simplify(linetobeam.Element))

vec_6 = Vector(division_6)
pt_36 = Point([pt_30, pt_31])
vec_7 = Vector(multiplication_10)
pt_37 = Point(pt_32)
loads = LoadsKaramba3D(Vector=Vector(0, 0, -1), LCase="0", mode="Gravity")
loads_2 = LoadsKaramba3D(ForceVector=vec_6, Local=False, PosInd=pt_36, LCase="0", mode="Point")
loads_3 = LoadsKaramba3D(ForceVector=vec_7, Local=False, PosInd=pt_37, LCase="0", mode="Point")
load = LoadKaramba3D(simplify(loads_2))
load_2 = LoadKaramba3D(simplify(loads_3))
load_3 = LoadKaramba3D(loads)
merge_2 = Merge(Data2=load, Data3=load_2)

int_12 = Integer(int_11)
vec_8 = Vector(vec_3)
vec_9 = Vector(vec_4)
beam_joints = BeamJointsKaramba3D(
    AtElementIdentifiers="bricks",
    CtKNMAtStartingNode=vec_8,
    CrKNmRadAtStartingNode=vec_9,
    CtKNMAtEndNode=vec_8,
    CrKNmRadAtEndNode=vec_9,
    DofsStart=int_12,
    DofsEnd=int_12,
    menu=[buttons(off, off, off, off, off, off), buttons(off, off, off, off, off, off)])
joint = JointKaramba3D(simplify(beam_joints))

panel_34 = Panel(merge_2)
element_2 = ElementKaramba3D(element)
support_4 = SupportKaramba3D(merge)
load_4 = LoadKaramba3D(merge_2)
joint_2 = JointKaramba3D(joint)
assemble = AssembleModelKaramba3D(Elem=element_2, Support=support_4, Load=load_4, Joint=joint_2, LimitDistance_m=0.005)  # -> Model, Info, Mass_kg, CenterOfGravity, LoadCaseNames
analyze = AnalyzeKaramba3D(Model=assemble.Model)  # -> CalculatedModel, simplify(MaximumDisplacement_cm), ResultingForceOfGravity_kN, ElasticEnergy_kNm; disabled
viewer_4 = ParamViewer(assemble.Mass_kg)
model = ModelKaramba3D(analyze.CalculatedModel)

data_18 = Data(list_2)
data_19 = Data(panel)
python_7 = GhPythonScript(x=data_18, y=data_19)  # -> path
# ---------- python_7: Python ----------
__author__ = "Edvard"
__version__ = "2023.06.19"

import rhinoscriptsyntax as rs
import os

path = os.path.join(x,y)
print path
# ---------- end python_7 ----------
data_20 = Data(python_7)

modelview = ModelViewKaramba3D(Model=model, ResultFactors="1", ResultCase=-1)  # -> Model, DeformedMesh, DeformedAxes, DeformedModel
react = ReactionForcesKaramba3D(AnalyzedModel=model)  # -> AnalyzedModel, simplify(ReactionForces_kN), simplify(ReactionMoments_kNm), simplify(SupportPosition), simplify(SumOfReactionForces_kN), simplify(SumOfReactionMoments_kNm)
b_res_force = BeamResultantForcesKaramba3D(AnalyzedModel=model, LoadCase=-1, MaximumProbingDistance_m=-1, NumberOfProbingPointsPerElement=3)  # -> AnalyzedModel, simplify(NormalForce_kN), ResultantBendingMoment_kNm, ResultantShearForce_kN
nodedisp = NodalDisplacementsKaramba3D(AnalyzedModel=model)  # -> AnalyzedModel, NodalTranslations_m, NodalRotations_rad
beamview = BeamViewKaramba3D(Model=modelview.Model)  # -> Model, MeshesOfRenderedBeams, DeformedBeamAxes, LegendColors, LegendTags
num_4 = Number(b_res_force.NormalForce_kN)
num_5 = Number(nodedisp.NodalTranslations_m)
item_8 = ListItem(List=react.ReactionMoments_kNm, Index=0, Wrap=True)
item_9 = ListItem(List=react.ReactionForces_kN, Index=0, Wrap=True)  # -> Item, Item1
support_forces_kn = Panel(item_9.Item1)

vlen = VectorLength(Vector=item_9.Item)
multiplication_11 = Multiplication(A=vlen, B="1000")
division_7 = Division(A=multiplication_11, B="9.81")

vlen_2 = VectorLength(Vector=item_9.Item1)
multiplication_12 = Multiplication(A=vlen_2, B="1000")
division_8 = Division(A=multiplication_12, B="9.81")

legend = Legend(Colour=beamview.LegendColors, Tags=beamview.LegendTags, LegendType=1)
data_21 = Data(pt_18)
data_22 = Data(int_10)

pt_38 = Point(pframe)
pdecon = Deconstruct(Point=pt_38)  # -> XComponent, YComponent, ZComponent
expression = Expression(x=pdecon.XComponent, Expression="round(x,1)")
expression_2 = Expression(x=pdecon.YComponent, Expression="round(x,1)")
expression_3 = Expression(x=pdecon.ZComponent, Expression="round(x,1)")
pt_39 = ConstructPoint(XCoordinate=expression, YCoordinate=expression_2, ZCoordinate=expression_3)
data_23 = Data(pt_17)
data_24 = Data(int_9)
pt_40 = Point(pt_39)
data_25 = Data(split_2.Positive)
panel_35 = Panel("INITIALIZE OUTPUT FILE")
python_8 = GhPythonScript(
    path=data_20,
    reach_points_coop=data_23,
    reach_values_coop=data_24,
    reach_points_single=data_21,
    reach_values_single=data_22,
    arch_dims=data_25,
    arch_bricks=pt_40,
    save_data=Toggle(False))  # -> out, output; inputs reach_points_coop: list of Point3d, reach_values_coop: list, reach_points_single: list of Point3d, reach_values_single: list, arch_dims: tree, arch_bricks: tree of Point3d
# ---------- python_8: Python ----------
__author__ = "Edvard"
__version__ = "2023.06.13"

import rhinoscriptsyntax as rs
import ghpythonlib.treehelpers as th

import os
import json

from collections import OrderedDict

def generate_filename(data):
    name = "a{:0>2}_s{:0>2}_r{:0>3}"
    
    angle = str(data["angle"]).split('.')[0]
    span = str(data["span"]).replace('.','')
    ratio = str(int(round(data["ratio"]*100,0))).replace('.','')
    
    filename = name.format(angle,span,ratio)
    return filename

def save_json(dims,data):
    filename = generate_filename(dims)
    filepath = os.path.join(path, filename)
    
    with open(filepath, "w") as f:
        json.dump(data,f,indent=4)
        f.close()

def reach_counts(saved_reach_data,branch_list,reach_points,reach_values):
    
    n_total = len(branch_list)
    n_notreach = 0
    n_reach = 0
    value = 0
    
    for arch_point in branch_list:
        try:
            idx = reach_points.index(arch_point)
            value += reach_values[idx]
            
            n_reach += 1
        except:
            n_notreach += 1
            
    saved_reach_data["bricks_total"] = n_total
    saved_reach_data["bricks_reach"] = n_reach
    saved_reach_data["bricks_notreach"] = n_notreach
    saved_reach_data["reach_ratio"] = round(n_reach/n_total,2)
    saved_reach_data["avg_reach_score"] = int(round(value/n_total,0))
    
    return saved_reach_data

for i in range(arch_dims.BranchCount):
    
    saved_variables = OrderedDict()
    saved_reach_data1 = OrderedDict()
    saved_reach_data2 = OrderedDict()
    output = OrderedDict()
    
    saved_reach_data1 = reach_counts(
        saved_reach_data1,
        arch_bricks.Branch(i),
        reach_points_coop,
        reach_values_coop,
        )
        
    saved_reach_data2 = reach_counts(
        saved_reach_data2,
        arch_bricks.Branch(i),
        reach_points_single,
        reach_values_single,
        )
    
    saved_variables["angle"] = arch_dims.Branch(i)[0]
    saved_variables["span"] = arch_dims.Branch(i)[1]
    saved_variables["ratio"] = arch_dims.Branch(i)[2]

    output["arch_info"] = saved_variables
    output["reach_data_coop"] = saved_reach_data1
    output["reach_data_single"] = saved_reach_data2
    output["analysis_data"] = {} #just initialize this, populate in other
    
    print output

    if save_data:
        save_json(saved_variables, output)
# ---------- end python_8 ----------

mesh_2 = Mesh(beamview.MeshesOfRenderedBeams)
num_6 = Number(simplify(num_4))
num_7 = Number(division_7)
num_8 = Number(division_8)
data_26 = Data(num_8)
data_27 = Data(item_9.Item)
data_28 = Data(item_8)
num_9 = Number(analyze.MaximumDisplacement_cm)
num_10 = Number(assemble.Mass_kg)

# ----
# ADD STRUCTURAL ANALYSIS RESULTS
panel_36 = Panel(list_4)
multiplication_13 = Multiplication(A=panel_36, B=100)
data_29 = Data(split_2.Positive)
panel_37 = Panel(multiplication_13)
data_30 = Data(num_10)
data_31 = Data(num_9)
data_32 = Data(data_27)
data_33 = Data(data_28)
python_9 = GhPythonScript(
    path=data_20,
    arch_dims=data_29,
    pcntg_complete=panel_37,
    mass=data_30,
    disp=data_31,
    rob_support_kg=data_26,
    rxn_force=data_32,
    rxn_moment=data_33,
    save_data=Toggle(False))  # -> out, output; inputs arch_dims: tree, pcntg_complete: Int32, mass: tree, disp: tree, rob_support_kg: tree, rxn_force: tree, rxn_moment: tree
# ---------- python_9: Python ----------
__author__ = "Edvard"
__version__ = "2023.06.13"

import rhinoscriptsyntax as rs
import ghpythonlib.treehelpers as th

import os
import json

from collections import OrderedDict

def generate_filename(data):
    name = "a{:0>2}_s{:0>2}_r{:0>3}"
    
    angle = str(data["angle"]).split('.')[0]
    width = str(data["width"]).replace('.','')
    ratio = str(int(round(data["ratio"]*100,0))).replace('.','')
    
    filename = name.format(angle,width,ratio)
    return filename

def save_json(arch_dims,analysis_data,p):
    
    filename = generate_filename(arch_dims)
    filepath = os.path.join(path, filename)
    
    if where_json(filepath):
        print "file exists", filepath

        with open(filepath, "r") as f:
            data = json.loads(f.read(),object_pairs_hook=OrderedDict)
            data["analysis_data"]["{}%".format(pcntg_complete)] = analysis_data
            f.close()
    else:
        print "file does not exist"
    
    with open(filepath, "w") as f:
        json.dump(data,f,indent=4)
        f.close()

def where_json(file_name):
    return os.path.exists(file_name)

for i in range(arch_dims.BranchCount):
    
    saved_variables = OrderedDict()
    saved_analysis_data = OrderedDict()
    
    saved_variables["angle"] = arch_dims.Branch(i)[0]
    saved_variables["width"] = arch_dims.Branch(i)[1]
    saved_variables["ratio"] = arch_dims.Branch(i)[2]
    
    saved_analysis_data["mass_kg"] = float('%.2f' % (mass.Branch(i)[0]))
    saved_analysis_data["disp_cm"] = round(disp.Branch(i)[0],4)
    saved_analysis_data["rob_support_kg"] = float('%.2f' % (rob_support_kg.Branch(i)[0]))
    saved_analysis_data["rxn_force_kn"] = [round(x,2) for x in rxn_force.Branch(i)[0]]
    saved_analysis_data["rxn_mom_knm"] = [round(x,2) for x in rxn_moment.Branch(i)[0]]
    
    if save_data:
        save_json(saved_variables, saved_analysis_data, pcntg_complete)
# ---------- end python_9 ----------

sort = SortList(Keys=num_6)  # -> Keys, ValuesA
avr = Average(Input=num_6)
panel_38 = Panel(python_8.out)
robot_support_kg = Panel(num_8)
other_end_support_kg = Panel(num_7)
support_forces_kn_2 = Panel(data_27)
support_moments_kn_m = Panel(data_28)
max_disp_cm = Panel(num_9)
total_mass_kg = Panel(num_10)
item_10 = ListItem(List=sort.Keys, Index=0, Wrap=True)  # -> Item1, Item
graph = QuickGraph(sort.Keys, SortOrder=0)
minforce_kn = Panel(item_10.Item)
avg_force_kn = Panel(avr)
max_force_kn = Panel(item_10.Item1)
